test file "focLib_MIL"

suite "focLib_MIL"

  case "Freemode_SW_ANF_01_07_08" [baseline]
    description: MIL-Test aus der MA (impmodel/Speed Control/Digital_Freemode_Check), uebertragen auf focLib.
      Baseline neu aufgenommen am 2026-11-03 mit Profil datasheet.
    model focLib, harness Freemode_Check_TestHarness (for focLib/Speed Control/Digital_Freemode_Check)
    pre-load callback:
      foc_startup('datasheet');
    baseline "Freemode_SW_ANF_01_07_08.mat"
      Digital_Freemode_Check:1

  case "MaxVelocity_SW_ANF_04" [baseline]
    description: MIL-Test aus der MA (impmodel/Speed Control/Speed calculator), uebertragen auf focLib.
      Baseline neu aufgenommen am 2026-11-03 mit Profil datasheet.
    model focLib, harness MaxVel_TestHarness (for focLib/Speed Control/Speed calculator)
    pre-load callback:
      foc_startup('datasheet');
    baseline "MaxVelocity_SW_ANF_04.mat"
      N_Ref

  case "SpeedController_SW_ANF_05" [baseline]
    description: MIL-Test aus der MA (impmodel/Speed Control/PI_Controller_Speed), uebertragen auf focLib.
      Baseline neu aufgenommen am 2026-11-03 mit Profil datasheet.
    model focLib, harness SpeedController_TestHarness (for focLib/Speed Control/PI_Controller_Speed)
    pre-load callback:
      foc_startup('datasheet');
    baseline "SpeedController_SW_ANF_05.mat"
      PI_Controller_Speed:1

  case "SafeState_SW_ANF_03" [baseline]
    description: MIL-Test aus der MA (impmodel/Speed Control/Mechanical_Freemode_Check), uebertragen auf focLib.
      Baseline neu aufgenommen am 2026-11-03 mit Profil datasheet.
    model focLib, harness SafeState_TestHarness (for focLib/Speed Control/Mechanical_Freemode_Check)
    pre-load callback:
      foc_startup('datasheet');
    baseline "SafeState_SW_ANF_03.mat"
      Mechanical_Freemode_Check:1